# Grasshopper definition CamtoGH.gh (Grasshopper 1.0.7)
# plug-ins: Firefly.X, gHowl

timer = Timer(TimerInterval=20, Target=udp_listener)  # disabled
udp = UDPReceiver(Address="192.168.1.115", Port="5001", Pattern=0)  # -> Info, Data
udp_listener = UDPListener(Port="5000")
panel = Panel(udp_listener)
panel_2 = Panel(udp.Data)
split = TextSplit(Text=panel_2, Separators=",")
cull = CullPattern(List=split, CullPattern=[True, True, True, False])
partition = PartitionList(List=cull, Size=3)  # -> simplify(Chunks)
panel_3 = Panel("""1
2""")
item = ListItem(List=partition, Index=0, Wrap=True)
item_2 = ListItem(List=partition, Index=panel_3, Wrap=True)
panel_4 = Panel(item_2)
panel_5 = Panel(item)
item_3 = ListItem(List=panel_4, Index="0", Wrap=True)
item_4 = ListItem(List=panel_4, Index="1", Wrap=True)
bnd = Bounds(Numbers=flatten(panel_5))
pt = ConstructPoint(XCoordinate=item_3, YCoordinate=item_4, ZCoordinate=0)
tag = TextTag3D(Location=pt, Text=panel_5, Size="5", Justification=7)
panel_6 = Panel(pt)
dom = ConstructDomain(DomainStart=0, DomainEnd=1)
remap = RemapNumbers(Value=flatten(panel_5), Source=flatten(bnd), Target=dom)  # -> flatten(Mapped), Clipped
dedomain = DeconstructDomain(Domain=dom)  # -> Start, End
cir = Circle(Plane=pt, Radius="10")
gradient = Gradient(
    LowerLimit=dedomain.Start,
    UpperLimit=dedomain.End,
    Parameter=remap.Mapped,
    stops=[0: RGB(243, 57, 0), 0.1: RGB(236, 27, 60), 0.2: RGB(210, 0, 118), 0.3: RGB(103, 0, 120), 0.4: RGB(39, 72, 161), 0.5: RGB(1, 192, 229), 0.6: RGB(18, 178, 90), 0.7: RGB(79, 186, 8), 0.8: RGB(220, 237, 32), 0.9: RGB(247, 159, 20), 1: RGB(243, 57, 0)])
boundary = BoundarySurfaces(Edges=cir)
preview = CustomPreview(Geometry=flatten(boundary), Material=gradient)
