# Grasshopper definition gh_mqtt.gh (Grasshopper 1.0.7)

panel = Panel("""ESP32/pub/red
ESP32/pub/blue""")
panel_2 = Panel("localhost")
panel_3 = Panel("broker.hivemq.com")
number_slider = Slider(4, range=1..4)
timer = Timer(TimerInterval=500, Target=python)  # disabled
python = GhPythonScript()  # -> out, a
# ---------- python: Python ----------
__author__ = "Cody"
__version__ = "2021.01.27"

import rhinoscriptsyntax as rs
import random

a = random.randint(1,4)
# ---------- end python ----------
panel_4 = Panel(python.a)
int = Integer("1883")
txt = Text("raspberrypi")
timer_2 = Timer(TimerInterval=100, Target=python_2)
button = Button()
panel_5 = Panel(python.a)
python_2 = GhPythonScript(setup=Button(), disconnect=Button(), host=txt, port=int, topics=panel)  # -> out, msg; inputs topics: list
# ---------- python_2: Python ----------
__author__ = "Ondrej Kyjanek"
__version__ = "2020.12.09"

import paho.mqtt.client as mqttc
import paho.mqtt.properties as properties
from collections import deque

class Callbacks(object):
    def __init__(self):
        self.queue = deque(maxlen=1)
        super(Callbacks, self).__init__()

    def on_connect(self, client, userdata, flags, rc, properties=None):
        pass
    
    def on_disconnect(self, client, userdata, rc, properties=None):
        pass

    def on_message(self, client, userdata, message):
        self.queue.append(message.payload.decode("utf-8"))

    def register(self, client):
        client.on_message = self.on_message
        client.on_connect = self.on_connect
        client.on_disconnect = self.on_disconnect 

if setup and not setup_done:
    try:
        client.disconnect()
        client.loop_stop()
        client.reinitialise()
    except:
        client = mqttc.Client(protocol=mqttc.MQTTv5)
    client.will_set(topics[1], payload="Client disconnected")
    
    callbacks = Callbacks()
    callbacks.register(client)
    
    client.connect(host,port)
    client.loop_start()
    client.subscribe([(x,0) for x in topics])
    setup_done = True
    last_msg = None
    print("Starting")
elif setup:
    print("Already started")
else:
    setup_done = False

if disconnect:
    client.disconnect()
    client.loop_stop()
    client = None

try:
    last_msg = callbacks.queue.popleft()
    print("Msg received")
except IndexError:
    pass
except Exception as e:
    print(e)

msg = last_msg
# ---------- end python_2 ----------
python_3 = GhPythonScript(setup=Button(), publish=Toggle(True), host=txt, port=int, msg=panel_4, topic="ESP32/rx")  # -> out
# ---------- python_3: Python ----------
__author__ = "Ondrej Kyjanek"
__version__ = "2020.12.09"

import paho.mqtt.client as mqttc
import paho.mqtt.properties as properties
from collections import deque

if setup and not setup_done:
    try:
        client.disconnect()
        client.loop_stop()
        client.reinitialise()
    except:
        client = mqttc.Client(protocol=mqttc.MQTTv5)
    client.connect(host,port)
    client.loop_start()
    setup_done = True
    print("Starting")
elif setup:
    print("Already started")
else:
    setup_done = False

if publish:
    props = properties.Properties(properties.PacketTypes.PUBLISH)
    props.UserProperty = ("name","grasshopper")
    print(props)
    client.publish(topic,msg,properties=props)
# ---------- end python_3 ----------
multiplication = Multiplication(A=panel_5, B=Slider(10, range=0..10))
cir = Circle(Plane=PlaneXY(0, 0, 0), Radius=multiplication)
crv = Curve(cir)
panel_6 = Panel(python_3)
panel_7 = Panel(python_2.out)
panel_8 = Panel(python_2.msg)
